# Grasshopper definition differ_calc.gh (Grasshopper 1.0.7)

width = Slider(21, range=0..100)
height = Slider(21, range=0..100)
length = Slider(21, range=0..100)
box = DomainBox(Base="{0,0,0}", X=width, Y=length, Z=height)
c_script = CSharpScript(mesh=box, calc=Button())  # -> out; inputs mesh: Mesh, calc: Boolean
# ---------- c_script: C# usings ----------
using Grasshopper.Plugin;
using System.Linq;
# ---------- c_script: C# ----------
    GH_RhinoScriptInterface GH = new GH_RhinoScriptInterface();
    GH_Document GHdoc = Grasshopper.Instances.ActiveCanvas.Document; //TODO Check if this has to be updated when a new document is opened


    if (!GH.IsEditorLoaded() || GHdoc == null)
    {
      RhinoApp.WriteLine("Open a grasshopper document and re-try");
      return;
    }

    List<Point3d> vertices = new List<Point3d>();
    foreach(Point3d vertex in mesh.Vertices) // import vertices
    {
      vertices.Add(vertex);
    }
    vertices = vertices.Union(vertices).ToList(); // Dedpulicate
    foreach(Point3d vertex in vertices)
    {
      Print(vertex.ToString());
    }

    List<Grasshopper.Kernel.Special.GH_NumberSlider> sliders = new List<Grasshopper.Kernel.Special.GH_NumberSlider>();
    List<string> names = new List<string>();
    List <decimal> vals = new List<decimal> ();

    foreach (var element in GHdoc.Objects)
    {
      if (element.GetType().ToString() == "Grasshopper.Kernel.Special.GH_NumberSlider") {
        var slider = element as Grasshopper.Kernel.Special.GH_NumberSlider;
        names.Add(slider.NickName);
        vals.Add(slider.CurrentValue);
      }
    }

    Print("******************");
    for(int i = 0; i < vals.Count;i++){
      updateSlider(names[i], vals[i] + 3);
    }

    // recalculate here <>
    GHdoc.ScheduleSolution(4);
    //
    List<Point3d> new_vert = new List<Point3d>();
    foreach(Point3d vertex in mesh.Vertices) // import vertices
    {
      new_vert.Add(vertex);
    }
    new_vert = new_vert.Union(new_vert).ToList(); // Dedpulicate
    foreach(Point3d vertex in new_vert)
    {
      Print(vertex.ToString());
    }
    for(int i = 0; i < vals.Count;i++){
      updateSlider(names[i], vals[i]);
    }

    // sliders - the original sliders and their values
    // vertices - the original vertices and their values


    //fore each component on the canvas
    /*
    foreach (IGH_DocumentObject obj in GrasshopperDocument.Objects)
    {
    //if that component is selected
    if(obj.Attributes.Selected)
    {
    //...and if expire_them = true, then expire that component and ask it to recompute
    if(expire_them) obj.ExpireSolution(true);
    }
    }
    */
# ---------- c_script: C# additional code ----------
  private void updateSlider(string name, decimal val){
    GH_RhinoScriptInterface GH = new GH_RhinoScriptInterface();
    GH_Document GHdoc = Grasshopper.Instances.ActiveCanvas.Document; //TODO Check if this has to be updated when a new document is opened

    foreach (var element in GHdoc.Objects)
    {
      if (element.GetType().ToString() == "Grasshopper.Kernel.Special.GH_NumberSlider") {
        var slider = element as Grasshopper.Kernel.Special.GH_NumberSlider;

        if (slider.NickName.Equals(name, StringComparison.Ordinal)) {
          slider.SetSliderValue(val);
        }
      }
    }
  }
# ---------- end c_script ----------
panel = Panel(c_script)
